# Grasshopper definition FoC_design_file.gh (Grasshopper 1.0.7)
# plug-ins: OpenNest, Pufferfish, Heteroptera

# ----
# wall length (cm)
number_slider = Slider(400, range=0..1000)

# ----
# wall height (cm)
number_slider_2 = Slider(200, range=0..1000)

# ----
# set physical assembly dimensionss
number_slider_3 = Slider(50, range=0..100)
xz = XZPlane(Origin=Point(0, 0, 0))
rectangle = Rectangle(Plane=xz, XSize=number_slider_3, YSize=Slider(45, range=0..1000), Radius=0)  # -> Rectangle, Length

# ----
# curve amplitude
number_slider_4 = Slider(60, range=0..100)

# ----
# curve frequency
number_slider_5 = Slider(4, range=0..10)

pt = ConstructPoint(XCoordinate=0, YCoordinate=0, ZCoordinate=0)
pt_2 = ConstructPoint(XCoordinate=number_slider, YCoordinate=0, ZCoordinate=0)
Z = UnitZ(Factor=number_slider_2)
range = Range(Domain=Domain(0, 1), Steps=number_slider_5)
ln = Line(StartPoint=pt, EndPoint=pt_2)
graph = GraphMapper(range, x0=0, x1=1, y0=0, y1=1, container_name="Sine", Equation_px=[0, 0.2608695626], Equation_py=[0, 1])
divide = DivideCurve(Curve=ln, Count=number_slider_5, Kinks=False)  # -> Points, Tangents, Parameters
pdecon = Deconstruct(Point=divide.Points)  # -> XComponent, YComponent, ZComponent
multiplication = Multiplication(A=graph, B=number_slider_4)
pt_3 = ConstructPoint(XCoordinate=pdecon.XComponent, YCoordinate=multiplication, ZCoordinate=pdecon.ZComponent)
intcrv = Interpolate(Vertices=pt_3, Degree=3, Periodic=False, KnotStyle=1)  # -> Curve, Length, Domain

# ----
# target geometry
extr = Extrude(Base=intcrv.Curve, Direction=Z)

# ----
# map wall segment to target geometry
number_slider_6 = Slider(90, range=0..100)
neg = Negative(Value=number_slider_6)
unroll = Unroll(MeshOrBrep=extr)  # -> Brep, Curves, Points, TextDotsLocation, TextDots
rad = Radians(Degrees=neg)
rotate = Rotate(Geometry=unroll.Brep, Angle=rad, Plane=PlaneXY(0, 0, 0))  # -> Geometry, Transform
X = UnitX(Factor=1)
rad_2 = Radians(Degrees="270")
rot3d = Rotate3D(Geometry=rotate.Geometry, Angle=rad_2, Center=Point(0, 0, 0), Axis=X)  # -> Geometry, Transform
addition = Addition(A=Slider(1, range=0..1), B=number_slider_3)
subtraction = Subtraction(A=number_slider, B=addition)
map_srf = MapToSurface(Curve=rectangle.Rectangle, Source=rot3d.Geometry, Target=extr)
dom = ConstructDomain(DomainStart=Slider(0, range=0..1), DomainEnd=subtraction)
md_slider = MDSlider(SliderMode=0, slider_value=Point(0.5, 0.5, 0.5), x_domain=Domain(0, 1), y_domain=Domain(0, 1), z_domain=Domain(0, 1))
remap = RemapNumbers(Value=Slider(0, range=0..3, expression="x*0.25"), Source=Domain(0, 1), Target=dom)  # -> Mapped, Clipped
boundary = BoundarySurfaces(Edges=map_srf)
X_2 = UnitX(Factor=remap.Mapped)
evalsrf = EvaluateSurface(Surface=boundary, Point=md_slider)  # -> Point, Normal, UDirection, VDirection, Frame
project = Project(Curve=map_srf, Brep=extr, Direction=evalsrf.Normal)
move = Move(Geometry=project, Motion=X_2)  # -> Geometry, Transform
srfsplit = SurfaceSplit(Surface=extr, Curves=move.Geometry)
item = ListItem(List=srfsplit, Index=0, Wrap=True)  # -> Item, Item1
area = Area(Geometry=item.Item)  # -> Area, Centroid
area_2 = Area(Geometry=item.Item1)  # -> Area, Centroid
smaller = SmallerThan(FirstNumber=area.Area, SecondNumber=area_2.Area)  # -> SmallerThan, OrEqualTo
filter = StreamFilter(Gate=smaller.SmallerThan, Stream0=item.Item1, Stream1=item.Item)
brep = Brep(filter)

# ----
# unroll wall segment for 2d packing
debrep = DeconstructBrep(Brep=brep)  # -> Faces, Edges, Vertices
crv = Curve(debrep.Edges)
unroll_2 = Unroll(MeshOrBrep=brep, Curves=crv, Points=debrep.Vertices)  # -> Brep, Curves, Points, TextDotsLocation, TextDots

# ----
# set bounding frames for assembly
md_slider_2 = MDSlider(SliderMode=0, slider_value=Point(0.5, 0.5, 0.5), x_domain=Domain(0, 1), y_domain=Domain(0, 1), z_domain=Domain(0, 1))
smesh = SimpleMesh(Brep=brep)
facen = FaceNormals(Mesh=smesh)  # -> Centers, Normals
panel = Panel("""-7.5
7.5""")
item_2 = ListItem(List=debrep.Edges, Index=0, Wrap=True)  # -> Item, Item1, Item2, Item3
eval = EvaluateCurve(Curve=reparameterize(item_2.Item), Parameter=md_slider_2)  # -> Point, Tangent, Angle
multiplication_2 = Multiplication(A=facen.Normals, B=panel)
xprod = CrossProduct(VectorA=facen.Normals, VectorB=eval.Tangent, Unitize=False)  # -> expr("x*-1", Vector), Length
extr_2 = Extrude(Base=item_2.Item, Direction=multiplication_2)
extr_3 = Extrude(Base=item_2.Item2, Direction=multiplication_2)
extr_4 = Extrude(Base=extr_3, Direction=expr("x*-1", xprod.Vector))
extr_5 = Extrude(Base=extr_2, Direction=xprod.Vector)
join = BrepJoin(Breps=extr_5)  # -> Breps, Closed
join_2 = BrepJoin(Breps=extr_4)  # -> Breps, Closed

# ----
# adjust wall segment surface orientation
number_slider_7 = Slider(90, range=0..100)
neg_2 = Negative(Value=number_slider_7)
rad_3 = Radians(Degrees=neg_2)
rotate_2 = Rotate(Geometry=unroll_2.Brep, Angle=rad_3, Plane=PlaneXY(0, 0, 0))  # -> Geometry, Transform
X_3 = UnitX(Factor=1)
rad_4 = Radians(Degrees="270")
rot3d_2 = Rotate3D(Geometry=rotate_2.Geometry, Angle=rad_4, Center=Point(0, 0, 0), Axis=X_3)  # -> Geometry, Transform
rad_5 = Radians(Degrees="90")
X_4 = UnitX(Factor=1)
neg_3 = Negative(Value=Slider(270, range=0..1000))
rad_6 = Radians(Degrees=neg_3)
rot3d_3 = Rotate3D(Geometry=rot3d_2.Geometry, Angle=rad_5, Center=Point(0, 0, 0), Axis=X_4)  # -> Geometry, Transform
rotate_3 = Rotate(Geometry=rot3d_3.Geometry, Angle=rad_6, Plane=PlaneXY(0, 0, 0))  # -> Geometry, Transform

# ----
# meshes
data = Data([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, {Plane=PlaneXY(0, 0, 0), X=Domain(-3.194646537, 2.937639318), Y=Domain(-2.555455267, 2.903945185), Z=Domain(0, 14.93235826)}, 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, {Plane=PlaneXY(0, 0, 0), X=Domain(-2.925978787, 2.68695876), Y=Domain(-8.422136307, 6.537876278), Z=Domain(0, 7.374498248)}, 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, {Plane=PlaneXY(0, 0, 0), X=Domain(-3.238841146, 2.664534003), Y=Domain(-4.465197399, 3.571575135), Z=Domain(0, 14.94169831)}, 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])

# ----
# file names
data_2 = Data(["03.11_foc_07", "03.11_foc_06", "03.11_foc_04", "03.11_foc_01", "03.11_foc_00", "03.11_foc_02", "03.11_foc_03", "30.10_foc_00", "01.11_foc_00", "01.11_foc_01", "02.11_foc_28", "02.11_foc_00", "02.11_foc_14", "02.11_foc_15", "02.11_foc_01", "02.11_foc_29", "02.11_foc_17", "02.11_foc_16", "02.11_foc_12", "02.11_foc_06", "02.11_foc_07", "02.11_foc_13", "02.11_foc_05", "02.11_foc_11", "02.11_foc_10", "02.11_foc_04", "02.11_foc_09", "02.11_foc_21", "02.11_foc_20", "02.11_foc_08", "02.11_foc_22", "02.11_foc_23", "02.11_foc_27", "02.11_foc_26", "02.11_foc_24", "02.11_foc_30", "02.11_foc_18", "02.11_foc_19", "02.11_foc_31", "02.11_foc_25"])

# ----
# get contours of
# convex hulls meshes
python = GhPythonScript(convex_hulls=data)  # -> out, a; inputs convex_hulls: list of Mesh
# ---------- python: Python ----------
import Rhino
import Rhino.Geometry as rg
import scriptcontext as sc

def get_smallest_contour(convex_hull):
    """Generate contours on multiple planes and return the smallest contour by area."""

    # Define potential planes for intersection based on the bounding box
    bbox = convex_hull.GetBoundingBox(True)
    
    # Define midpoints along each axis
    mid_x = (bbox.Min.X + bbox.Max.X) / 2
    mid_y = (bbox.Min.Y + bbox.Max.Y) / 2
    mid_z = (bbox.Min.Z + bbox.Max.Z) / 2

    # Define planes centered at the bounding box's midpoint with normals along X, Y, and Z
    planes = [
        rg.Plane(rg.Point3d(mid_x, mid_y, mid_z), rg.Vector3d(1, 0, 0)),  # X-aligned plane
        rg.Plane(rg.Point3d(mid_x, mid_y, mid_z), rg.Vector3d(0, 1, 0)),  # Y-aligned plane
        rg.Plane(rg.Point3d(mid_x, mid_y, mid_z), rg.Vector3d(0, 0, 1))   # Z-aligned plane
    ]
    
    smallest_contour = None
    smallest_area = None

    # Generate contours for each plane and determine the smallest one by area
    for plane in planes:
        if isinstance(convex_hull, rg.Brep):
            # Intersect Brep with the plane
            intersection_curves = rg.Intersect.Intersection.BrepPlane(convex_hull, plane, sc.doc.ModelAbsoluteTolerance)
            if intersection_curves:
                joined_curves = rg.Curve.JoinCurves(intersection_curves, sc.doc.ModelAbsoluteTolerance)
                contour = joined_curves[0] if joined_curves else intersection_curves[0]
                
                # Calculate area of the contour if it’s closed
                if contour and contour.IsClosed:
                    area_props = rg.AreaMassProperties.Compute(contour)
                    if area_props:
                        area = area_props.Area
                        if smallest_area is None or area < smallest_area:
                            smallest_area = area
                            smallest_contour = contour

        elif isinstance(convex_hull, rg.Mesh):
            # Intersect Mesh with the plane
            polylines = rg.Intersect.Intersection.MeshPlane(convex_hull, plane)
            if polylines:
                curves = [polyline.ToNurbsCurve() for polyline in polylines]
                joined_curves = rg.Curve.JoinCurves(curves, sc.doc.ModelAbsoluteTolerance)
                contour = joined_curves[0] if joined_curves else curves[0]
                
                # Calculate area of the contour if it’s closed
                if contour and contour.IsClosed:
                    area_props = rg.AreaMassProperties.Compute(contour)
                    if area_props:
                        area = area_props.Area
                        if smallest_area is None or area < smallest_area:
                            smallest_area = area
                            smallest_contour = contour

    if smallest_contour is None:
        print("Failed to extract a contour for the convex hull.")
    return smallest_contour

# Input: convex_hulls (list of Mesh or Brep objects)
# Output: contours (list of Curve objects)

contours = []

for convex_hull in convex_hulls:
    contour = get_smallest_contour(convex_hull)
    if contour:
        contours.append(contour)
    else:
        print("Failed to extract contour for a convex hull.")

# Output the list of contours
a = contours
# ---------- end python ----------

# ----
# bounding support
brep_2 = Brep([join_2.Breps, join.Breps])

# ----
# pack and map convex hull contours
join_3 = JoinCurves(Curves=python.a, Preserve=False)
geo = Geometry(brep)

# ---- group: This projects polygons to plane
crv_2 = Curve(python.a)
pack = PackObjects(Geo=crv_2, Plane=join_3, X=1, Y=1, Tolerabce=3.14)  # -> Geo, Transformation

# ----
opennest = OpenNest(
    Sheets=rotate_3.Geometry,
    Geo=pack.Geo,
    Spacing=Slider(0, range=0..100),
    Placement=1,
    Tolerance=Slider(0.1, range=0..0.1),
    Rotations=Slider(4, range=0..10),
    Iterations=1,
    Seed=Slider(6, range=0..10),
    Reset=True,
    Run=Toggle(True))  # -> Sheets, Geo, ID, Transform, IDS
boundary_2 = BoundarySurfaces(Edges=opennest.Sheets)
cull = CullPattern(List=opennest.Geo, CullPattern=invert(opennest.IDS))
transform = Transform(Geometry=data, Transform=pack.Transformation)
dim = Dimensions(Surface=boundary_2)  # -> UDimension, VDimension
transform_2 = Transform(Geometry=transform, Transform=opennest.Transform)
cull_2 = CullPattern(List=transform_2, CullPattern=invert(opennest.IDS))
rebsrf = RebuildSurface(Surface=geo, DomainU=dim.UDimension, DomainV=dim.VDimension)
map_srf_2 = MapToSurface(Curve=cull, Source=rotate_3.Geometry, Target=rebsrf)

# ----
# align convex hull geometries with mapped contours
target_curve = Curve(map_srf_2)
geo_2 = Geometry(cull_2)
crv_3 = Curve(cull)

# ---- group: Plane 1
crv_4 = Curve(reparameterize(target_curve))
eval_2 = EvaluateCurve(Curve=crv_4, Parameter=Slider(0, range=0..1))  # -> Point, Tangent, Angle
eval_3 = EvaluateCurve(Curve=crv_4, Parameter=Slider(0.26, range=0..1))  # -> Point, Tangent, Angle
xprod_2 = CrossProduct(VectorA=eval_2.Tangent, VectorB=eval_3.Tangent, Unitize=False)  # -> Vector, Length
xprod_3 = CrossProduct(VectorA=eval_2.Point, VectorB=xprod_2.Vector, Unitize=False)  # -> Vector, Length
divide_2 = DivideCurve(Curve=crv_4, Count=Slider(125, range=0..1000), Kinks=False)  # -> Points, Tangents, Parameters
avr = Average(Input=divide_2.Points)
pl = ConstructPlane(Origin=simplify(flatten(avr)), XAxis=eval_2.Tangent, YAxis=xprod_3.Vector)

crv_5 = Curve(reparameterize(crv_3))
eval_4 = EvaluateCurve(Curve=crv_5, Parameter=Slider(0, range=0..1))  # -> Point, Tangent, Angle
eval_5 = EvaluateCurve(Curve=crv_5, Parameter=Slider(0.26, range=0..1))  # -> Point, Tangent, Angle
xprod_4 = CrossProduct(VectorA=eval_4.Tangent, VectorB=eval_5.Tangent, Unitize=False)  # -> Vector, Length
xprod_5 = CrossProduct(VectorA=eval_4.Point, VectorB=xprod_4.Vector, Unitize=False)  # -> Vector, Length

# ----
center = Center(Geometry=crv_5)  # -> Center, Dimension

# ---- group: Plane 1 (continued)
pl_2 = ConstructPlane(Origin=center.Center, XAxis=eval_4.Tangent, YAxis=xprod_5.Vector)

# ----
orient = Orient(Geometry=simplify(graft(geo_2)), Source=simplify(graft(pl_2)), Target=simplify(graft(pl)))  # -> Geometry, Transform

lng = ListLength(List=flatten(orient.Geometry))
random = Random(Range=Domain(0, 1), Number=lng, Seed=2)
gradient = Gradient(
    LowerLimit=0,
    UpperLimit=1,
    Parameter=random,
    stops=[0: RGB(243, 57, 0), 0.1: RGB(236, 27, 60), 0.3: RGB(103, 0, 120), 0.4: RGB(39, 72, 161), 0.6: RGB(18, 178, 90), 0.7: RGB(79, 186, 8), 0.8: RGB(220, 237, 32), 0.9: RGB(247, 159, 20), 1: RGB(1, 192, 229), 1: RGB(243, 57, 0)])
preview = CustomPreview(Geometry=flatten(brep_2), Material=ColourSwatch(SwatchColor=RGB(255, 254, 254)))

# ----
# packed meshes
preview_2 = CustomPreview(Geometry=flatten(orient.Geometry), Material=gradient)

# ----
# export objs for assembly
button = Button()
python_2 = GhPythonScript(save=button, meshes=flatten(orient.Geometry), file_names=data_2)  # -> out; inputs save: Boolean, meshes: list of Mesh, file_names: list; disabled
# ---------- python_2: Python ----------
import Rhino
import os
import System
import compas
from compas.datastructures import Mesh

def save_mesh_as_obj(mesh, filename):
    # Get the path of the current Grasshopper document
    gh_file_path = ghenv.Component.OnPingDocument().FilePath
    current_folder = os.path.dirname(gh_file_path)
    
    # Define the path to OBJ_Files one level above the current folder
    obj_folder = os.path.join(os.path.dirname(current_folder), "OBJ_Files")
    
    # Build the full file path in the OBJ_Files folder
    full_path = os.path.join(obj_folder, filename + ".obj")
    
    # Get the vertices from the mesh
    vertices = [(vertex.X, vertex.Y, vertex.Z) for vertex in mesh.Vertices]

    # Get the faces from the mesh
    faces = []
    for face in mesh.Faces:
        if face.IsQuad:
            faces.append([face.A, face.B, face.C, face.D])  # Quad face
        else:
            faces.append([face.A, face.B, face.C])  # Triangle face
        
    mesh = Mesh.from_vertices_and_faces(vertices, faces)
    mesh.to_obj(full_path)
    print("Mesh successfully saved to:", full_path)

# Ensure that `file_names` list length matches `meshes` list length
if len(meshes) == len(file_names):
    for mesh, filename in zip(meshes, file_names):
        save_mesh_as_obj(mesh, filename)
else:
    print("Error: The number of file names does not match the number of meshes.")
# ---------- end python_2 ----------
python_3 = GhPythonScript(save=button, meshes=flatten(brep_2))  # -> out; inputs save: Boolean, meshes: list of Mesh; disabled
# ---------- python_3: Python ----------
import Rhino
import os
import System
import compas
from compas.datastructures import Mesh

import Rhino
import os
import System
import compas
from compas.datastructures import Mesh

def save_mesh_as_obj(mesh, filename):
    # Get the path of the current Grasshopper document
    gh_file_path = ghenv.Component.OnPingDocument().FilePath
    current_folder = os.path.dirname(gh_file_path)
    
    # Define the path to OBJ_Files one level above the current folder
    obj_folder = os.path.join(os.path.dirname(current_folder), "OBJ_Files")
    
    # Build the full file path in the OBJ_Files folder
    full_path = os.path.join(obj_folder, filename + ".obj")
    
    # Get the vertices from the mesh
    vertices = [(vertex.X, vertex.Y, vertex.Z) for vertex in mesh.Vertices]

    # Get the faces from the mesh
    faces = []
    for face in mesh.Faces:
        if face.IsQuad:
            faces.append([face.A, face.B, face.C, face.D])  # Quad face
        else:
            faces.append([face.A, face.B, face.C])  # Triangle face
        
    mesh = Mesh.from_vertices_and_faces(vertices, faces)
    mesh.to_obj(full_path)
    print("Mesh successfully saved to:", full_path)

# Save each mesh with a custom filename in the OBJ_Files directory
for i, mesh in enumerate(meshes):
    filename = "wall_support_" + str(i)
    save_mesh_as_obj(mesh, filename)
# ---------- end python_3 ----------
