# Grasshopper definition SBE_convex_hull.gh (Grasshopper 1.0.7)
# plug-ins: GhPolyhedra, Pufferfish

# ---- group: Tool in mm (with nozzle on origin)
mesh = Mesh(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)

# ----
munion = MeshUnion(Meshes=mesh)
demesh = DeconstructMesh(Mesh=munion)  # -> flatten(Vertices), Faces, Colours, Normals
quickhull = QuickHull(Points=demesh.Vertices)  # -> Curves, Mesh
disc = Discontinuity(Curve=quickhull.Curves, Level=1)  # -> Points, Parameters
item = ListItem(List=disc.Points, Index=0, Wrap=True)  # -> Item, Item1, Item2, Item3
srf4pt = _4PointSurface(CornerA=item.Item, CornerB=item.Item1, CornerC=item.Item2, CornerD=item.Item3)  # -> flatten(Surface)
join = BrepJoin(Breps=srf4pt)  # -> Breps, Closed
smesh = SimpleMesh(Brep=join.Breps)
clsmsh = CloseMesh(Mesh=smesh, Quadrangulate=True)  # -> Closed, Amount, Openings, R

# ---- group: Convex hull
mesh_2 = Mesh(clsmsh.Closed)
