# Grasshopper definition SBE_design_file_mac_rhino8.gh (Grasshopper 1.0.7)
# plug-ins: OpenNest, Pufferfish

# ----
# wall length (cm)
number_slider = Slider(300, range=0..1000)

# ----
# wall height (cm)
number_slider_2 = Slider(180, range=0..1000)

# ----
# set physical assembly dimensionss
number_slider_3 = Slider(100, range=0..100)
number_slider_4 = Slider(40, range=0..1000)
xz = XZPlane(Origin=Point(0, 0, 0))
rectangle = Rectangle(Plane=xz, XSize=number_slider_3, YSize=number_slider_4, Radius=0)  # -> Rectangle, Length

# ----
# curve amplitude
number_slider_5 = Slider(0, range=0..100)

# ----
# curve frequency
number_slider_6 = Slider(1, range=0..10)

pt = ConstructPoint(XCoordinate=0, YCoordinate=0, ZCoordinate=0)
pt_2 = ConstructPoint(XCoordinate=number_slider, YCoordinate=0, ZCoordinate=0)
Z = UnitZ(Factor=number_slider_2)
range = Range(Domain=Domain(0, 1), Steps=number_slider_6)
ln = Line(StartPoint=pt, EndPoint=pt_2)
graph = GraphMapper(range, x0=0, x1=1, y0=0, y1=1, container_name="Sine", Equation_px=[0, 0.2608695626], Equation_py=[0, 1])
divide = DivideCurve(Curve=ln, Count=number_slider_6, Kinks=False)  # -> Points, Tangents, Parameters
pdecon = Deconstruct(Point=divide.Points)  # -> XComponent, YComponent, ZComponent
multiplication = Multiplication(A=graph, B=number_slider_5)
pt_3 = ConstructPoint(XCoordinate=pdecon.XComponent, YCoordinate=multiplication, ZCoordinate=pdecon.ZComponent)
intcrv = Interpolate(Vertices=pt_3, Degree=3, Periodic=False, KnotStyle=1)  # -> Curve, Length, Domain

# ----
# target geometry
extr = Extrude(Base=intcrv.Curve, Direction=Z)

# ----
# file_names
data = Data(["19.06_sbe_l_00", "19.06_sbe_l_01", "19.06_sbe_l_02", "19.06_sbe_l_03", "19.06_sbe_l_04", "19.06_sbe_l_06", "19.06_sbe_l_07", "19.06_sbe_l_11", "19.06_sbe_l_12", "19.06_sbe_l_14", "19.06_sbe_l_17", "19.06_sbe_l_19", "19.06_sbe_l_20", "19.06_sbe_l_21", "19.06_sbe_l_25", "19.06_sbe_l_26", "19.06_sbe_l_27", "19.06_sbe_b_00", "19.06_sbe_b_01", "19.06_sbe_b_02", "19.06_sbe_b_03", "19.06_sbe_b_04", "19.06_sbe_b_05", "19.06_sbe_b_06", "19.06_sbe_i_00", "19.06_sbe_i_01", "19.06_sbe_i_02", "19.06_sbe_i_03", "19.06_sbe_i_04"])

# ----
# meshes
data_2 = Data([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])

# ----
# get contours of
# convex hulls meshes
python = GhPythonScript(convex_hulls=data_2)  # -> out, a; inputs convex_hulls: list of Mesh
# ---------- python: Python ----------
import Rhino
import Rhino.Geometry as rg
import scriptcontext as sc

def get_smallest_contour(convex_hull):
    """Generate contours on multiple planes and return the smallest contour by area."""

    # Define potential planes for intersection based on the bounding box
    bbox = convex_hull.GetBoundingBox(True)
    
    # Define midpoints along each axis
    mid_x = (bbox.Min.X + bbox.Max.X) / 2
    mid_y = (bbox.Min.Y + bbox.Max.Y) / 2
    mid_z = (bbox.Min.Z + bbox.Max.Z) / 2

    # Define planes centered at the bounding box's midpoint with normals along X, Y, and Z
    planes = [
        rg.Plane(rg.Point3d(mid_x, mid_y, mid_z), rg.Vector3d(1, 0, 0)),  # X-aligned plane
        rg.Plane(rg.Point3d(mid_x, mid_y, mid_z), rg.Vector3d(0, 1, 0)),  # Y-aligned plane
        rg.Plane(rg.Point3d(mid_x, mid_y, mid_z), rg.Vector3d(0, 0, 1))   # Z-aligned plane
    ]
    
    smallest_contour = None
    smallest_area = None

    # Generate contours for each plane and determine the smallest one by area
    for plane in planes:
        if isinstance(convex_hull, rg.Brep):
            # Intersect Brep with the plane
            intersection_curves = rg.Intersect.Intersection.BrepPlane(convex_hull, plane, sc.doc.ModelAbsoluteTolerance)
            if intersection_curves:
                joined_curves = rg.Curve.JoinCurves(intersection_curves, sc.doc.ModelAbsoluteTolerance)
                contour = joined_curves[0] if joined_curves else intersection_curves[0]
                
                # Calculate area of the contour if it’s closed
                if contour and contour.IsClosed:
                    area_props = rg.AreaMassProperties.Compute(contour)
                    if area_props:
                        area = area_props.Area
                        if smallest_area is None or area < smallest_area:
                            smallest_area = area
                            smallest_contour = contour

        elif isinstance(convex_hull, rg.Mesh):
            # Intersect Mesh with the plane
            polylines = rg.Intersect.Intersection.MeshPlane(convex_hull, plane)
            if polylines:
                curves = [polyline.ToNurbsCurve() for polyline in polylines]
                joined_curves = rg.Curve.JoinCurves(curves, sc.doc.ModelAbsoluteTolerance)
                contour = joined_curves[0] if joined_curves else curves[0]
                
                # Calculate area of the contour if it’s closed
                if contour and contour.IsClosed:
                    area_props = rg.AreaMassProperties.Compute(contour)
                    if area_props:
                        area = area_props.Area
                        if smallest_area is None or area < smallest_area:
                            smallest_area = area
                            smallest_contour = contour

    if smallest_contour is None:
        print("Failed to extract a contour for the convex hull.")
    return smallest_contour

# Input: convex_hulls (list of Mesh or Brep objects)
# Output: contours (list of Curve objects)

contours = []

for convex_hull in convex_hulls:
    contour = get_smallest_contour(convex_hull)
    if contour:
        contours.append(contour)
    else:
        print("Failed to extract contour for a convex hull.")

# Output the list of contours
a = contours
# ---------- end python ----------

# ----
# pack and map convex hull contours using custom algorithm
number_slider_7 = Slider(0, range=0..2)
num = Number(number_slider_4)
num_2 = Number(number_slider_3)
geo = Geometry([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])
rectangle_2 = Rectangle(Plane=PlaneXY(0, 0, 0), XSize=num_2, YSize=num, Radius=0)  # -> Rectangle, Length
# Main function: unified_assembly_pack - the entry point
# Packing algorithm: pack_with_enhanced_algorithm - the core packing logic
# Skyline class: Tracks the upper profile of placed rectangles
# Position finding: find_optimal_position_tight - finds best positions for new shapes
# Validation: is_valid_position_tight - checks if a position is valid
# Optimization: tight_optimization_pass - post-processing to improve packing
# Scoring functions: Various functions to evaluate position quality
python_2 = GhPythonScript(curves=flatten(geo), spacing=number_slider_7, container_width=num_2, container_height=num)  # -> out, packed_curves, all_transforms, placed_indices, final_info; inputs curves: list of Curve
# ---------- python_2: Python ----------
import Rhino.Geometry as rg
import math
import traceback

def unified_assembly_pack(input_curves, container_w=None, container_h=None, spacing=0.5):
    """
    Enhanced packing algorithm with improved tightness.
    Returns: packed_curves, all_transforms, placed_indices, info_text
    """
    
    if not input_curves:
        return [], [], [], "Error: No input curves provided."
    
    # Convert to list and handle single curve input
    curve_list = list(input_curves) if hasattr(input_curves, '__iter__') else [input_curves]
    
    # Extract shape data for all curves
    all_shapes = []
    for i, curve in enumerate(curve_list):
        shape_data = {'index': i, 'original_curve': curve, 'is_valid': False, 'placed': False}
        if curve:
            try:
                bbox = curve.GetBoundingBox(True)
                width = bbox.Max.X - bbox.Min.X
                height = bbox.Max.Y - bbox.Min.Y
                if width > 1e-6 and height > 1e-6:
                    shape_data.update({
                        'width': width,
                        'height': height,
                        'min_x': bbox.Min.X,
                        'min_y': bbox.Min.Y,
                        'area': width * height,
                        'aspect_ratio': max(width, height) / min(width, height),
                        'is_valid': True,
                        'x': 0,
                        'y': 0
                    })
            except Exception:
                pass
        all_shapes.append(shape_data)
    
    valid_shapes = [s for s in all_shapes if s['is_valid']]
    if not valid_shapes:
        return [], [rg.Transform.Identity for _ in all_shapes], [], "No valid curves found"
    
    # Auto-calculate container if needed
    if not container_w or container_w <= 0 or not container_h or container_h <= 0:
        total_area = sum(s['area'] for s in valid_shapes)
        estimated_side = math.sqrt(total_area) * 1.15  # Tighter initial estimate
        container_w = container_w if container_w and container_w > 0 else max(estimated_side, 100)
        container_h = container_h if container_h and container_h > 0 else max(estimated_side, 100)
    
    # Smart shape ordering for tighter packing
    shapes_to_pack = sorted(valid_shapes, key=lambda x: (-x['area'], -x['aspect_ratio']))
    
    # Packing algorithm
    placed_shapes, efficiency, actual_width, actual_height = pack_with_enhanced_algorithm(
        shapes_to_pack, container_w, container_h, spacing
    )
    
    # --- Prepare final outputs ---
    result_curves = []
    all_transforms = [rg.Transform.Identity] * len(all_shapes)
    placed_indices = []
    
    for placed_shape in placed_shapes:
        # Update the master list
        all_shapes[placed_shape['index']].update(placed_shape)
        all_shapes[placed_shape['index']]['placed'] = True
        placed_indices.append(placed_shape['index'])
        
        # Create the transformed curve and transformation matrix
        try:
            dx = placed_shape['x'] - placed_shape['min_x']
            dy = placed_shape['y'] - placed_shape['min_y']
            transform = rg.Transform.Translation(dx, dy, 0)
            all_transforms[placed_shape['index']] = transform
            
            new_curve = placed_shape['original_curve'].DuplicateCurve()
            if abs(dx) > 1e-6 or abs(dy) > 1e-6:
                new_curve.Transform(transform)
            result_curves.append(new_curve)
        except Exception:
            pass  # Keep identity transform on error
    
    placed_count = len(placed_shapes)
    info_text = "Enhanced Pack - Placed: {}/{}, Efficiency: {:.1f}%, Used Area: {:.1f}x{:.1f}".format(
        placed_count, len(all_shapes), efficiency, actual_width, actual_height)
    
    # Sort indices for clean output
    placed_indices.sort()
    
    return result_curves, all_transforms, placed_indices, info_text

def pack_with_enhanced_algorithm(shapes, container_w, container_h, spacing):
    """Pack shapes using enhanced algorithm with tighter positioning."""
    
    placed_shapes = []
    skyline = Skyline()
    
    for shape in shapes:
        best_position = find_optimal_position_tight(
            shape, placed_shapes, skyline, container_w, container_h, spacing
        )
        
        if best_position:
            shape['x'], shape['y'] = best_position
            placed_shapes.append(shape)
            skyline.add_rectangle(shape['x'], shape['y'], shape['width'], shape['height'])
    
    # Local optimization for tighter packing
    if len(placed_shapes) > 1:
        placed_shapes = tight_optimization_pass(placed_shapes, container_w, container_h, spacing)
    
    # Calculate statistics
    if placed_shapes:
        actual_width = max(s['x'] + s['width'] for s in placed_shapes)
        actual_height = max(s['y'] + s['height'] for s in placed_shapes)
        total_area = sum(s['area'] for s in placed_shapes)
        used_area = actual_width * actual_height
        efficiency = (total_area / used_area * 100) if used_area > 0 else 0
    else:
        efficiency = 0
        actual_width = 0
        actual_height = 0
    
    return placed_shapes, efficiency, actual_width, actual_height

class Skyline:
    """Track the upper profile of placed rectangles."""
    
    def __init__(self):
        self.points = [(0, 0)]
    
    def add_rectangle(self, x, y, width, height):
        """Add a rectangle and update the skyline."""
        new_points = []
        left_x = x
        right_x = x + width
        top_y = y + height
        
        # Keep points outside the rectangle range
        for sx, sy in self.points:
            if sx < left_x or sx > right_x:
                new_points.append((sx, sy))
        
        # Add new skyline segment
        new_points.extend([(left_x, top_y), (right_x, y)])
        
        self.points = sorted(list(set(new_points)))
        self._simplify()
    
    def _simplify(self):
        """Remove redundant points."""
        if len(self.points) <= 2:
            return
        
        simplified = [self.points[0]]
        for i in range(1, len(self.points) - 1):
            curr = self.points[i]
            prev = self.points[i-1]
            next_pt = self.points[i+1]
            
            # Keep point if it changes the profile
            if not (prev[1] == curr[1] == next_pt[1]):
                simplified.append(curr)
        
        simplified.append(self.points[-1])
        self.points = simplified
    
    def get_height_at(self, x):
        """Get skyline height at position x."""
        if not self.points or x <= self.points[0][0]:
            return 0
        
        for i in range(len(self.points) - 1):
            if self.points[i][0] <= x <= self.points[i+1][0]:
                return max(self.points[i][1], self.points[i+1][1])
        
        return self.points[-1][1]

def find_optimal_position_tight(shape, placed_shapes, skyline, container_w, container_h, spacing):
    """Find optimal position with emphasis on tight packing."""
    
    candidates = []
    
    # Bottom-left corner (always good)
    candidates.append((0, 0))
    
    # Skyline-based positions (key for tight packing)
    step_size = max(0.1, spacing * 0.1)  # Very fine stepping for precision
    x = 0
    while x <= container_w - shape['width']:
        y = skyline.get_height_at(x)
        if y + shape['height'] + spacing <= container_h:
            candidates.append((x, y))
        x += step_size
    
    # Critical positions from existing shapes
    for placed in placed_shapes:
        # Right edge positions
        candidates.append((placed['x'] + placed['width'] + spacing, placed['y']))
        candidates.append((placed['x'] + placed['width'] + spacing, 0))  # Floor position
        
        # Top edge positions  
        candidates.append((placed['x'], placed['y'] + placed['height'] + spacing))
        
        # Corner nesting positions
        candidates.append((placed['x'] + placed['width'] + spacing, 
                          placed['y'] + placed['height'] + spacing))
        
        # Left-aligned on top
        candidates.append((placed['x'], placed['y'] + placed['height'] + spacing))
        
        # Right-aligned on top
        right_align_x = placed['x'] + placed['width'] - shape['width']
        if right_align_x >= 0:
            candidates.append((right_align_x, placed['y'] + placed['height'] + spacing))
    
    # Score and find best position
    best_pos = None
    best_score = float('inf')
    
    for x, y in candidates:
        if is_valid_position_tight(x, y, shape, placed_shapes, container_w, container_h, spacing):
            # Tighter scoring: heavily prioritize lower positions, then left
            score = y * 10000 + x * 100
            
            # Bonus for good bottom support
            bottom_support = calculate_bottom_support(x, y, shape, placed_shapes, spacing)
            score -= bottom_support * 5000  # Strong bonus for support
            
            # Penalty for creating gaps
            gap_penalty = calculate_gap_penalty(x, y, shape, placed_shapes, container_w, container_h)
            score += gap_penalty * 1000
            
            if score < best_score:
                best_score = score
                best_pos = (x, y)
    
    return best_pos

def calculate_bottom_support(x, y, shape, placed_shapes, spacing):
    """Calculate how much support the shape has from below (0-1)."""
    if y <= 0.1:  # On ground
        return 1.0
    
    total_support = 0
    for placed in placed_shapes:
        if abs((placed['y'] + placed['height'] + spacing) - y) <= 0.1:
            # Calculate horizontal overlap
            overlap_start = max(x, placed['x'])
            overlap_end = min(x + shape['width'], placed['x'] + placed['width'])
            overlap = max(0, overlap_end - overlap_start)
            total_support += overlap / shape['width']
    
    return min(1.0, total_support)

def calculate_gap_penalty(x, y, shape, placed_shapes, container_w, container_h):
    """Calculate penalty for creating unusable gaps."""
    penalty = 0
    
    # Check for creating narrow unusable spaces
    right_edge = x + shape['width']
    top_edge = y + shape['height']
    
    # Penalty for narrow right gap
    if right_edge < container_w:
        remaining_width = container_w - right_edge
        if remaining_width < shape['width'] * 0.3:  # Too narrow for most shapes
            penalty += remaining_width
    
    # Penalty for narrow top gap
    if top_edge < container_h:
        remaining_height = container_h - top_edge
        if remaining_height < shape['height'] * 0.3:  # Too narrow for most shapes
            penalty += remaining_height
    
    return penalty

def is_valid_position_tight(x, y, shape, placed_shapes, container_w, container_h, spacing):
    """Check if position is valid with tight constraints."""
    
    # Boundary check
    if (x < 0 or y < 0 or 
        x + shape['width'] > container_w or 
        y + shape['height'] > container_h):
        return False
    
    # Collision check with proper spacing
    for placed in placed_shapes:
        if not (x + shape['width'] + spacing <= placed['x'] or
               placed['x'] + placed['width'] + spacing <= x or
               y + shape['height'] + spacing <= placed['y'] or
               placed['y'] + placed['height'] + spacing <= y):
            return False
    
    return True

def tight_optimization_pass(placed_shapes, container_w, container_h, spacing):
    """Optimization pass for maximum tightness."""
    
    optimized = placed_shapes[:]
    max_iterations = 3  # Limit iterations for performance
    
    for iteration in range(max_iterations):
        improved = False
        
        # Sort by Y position (optimize from bottom up)
        optimized.sort(key=lambda s: (s['y'], s['x']))
        
        for i, shape in enumerate(optimized):
            original_x, original_y = shape['x'], shape['y']
            other_shapes = [s for j, s in enumerate(optimized) if j != i]
            
            # Try to move down as much as possible
            for test_y in range(int(original_y), -1, -1):
                if is_valid_position_tight(shape['x'], test_y, shape, other_shapes, 
                                         container_w, container_h, spacing):
                    if test_y < original_y:
                        shape['y'] = test_y
                        improved = True
                        break
                else:
                    break
            
            # Try to move left as much as possible
            for test_x in range(int(shape['x']), -1, -1):
                if is_valid_position_tight(test_x, shape['y'], shape, other_shapes, 
                                         container_w, container_h, spacing):
                    if test_x < shape['x']:
                        shape['x'] = test_x
                        improved = True
                        break
                else:
                    break
        
        if not improved:
            break
    
    return optimized

# --- GRASSHOPPER EXECUTION ---
try:
    input_curves = curves if 'curves' in locals() else []
    
    input_width = None
    input_height = None
    
    if 'container_width' in locals() and container_width is not None:
        try:
            input_width = float(container_width)
        except:
            input_width = None
            
    if 'container_height' in locals() and container_height is not None:
        try:
            input_height = float(container_height)
        except:
            input_height = None
    
    input_spacing = 0.5
    if 'spacing' in locals() and spacing is not None:
        try:
            input_spacing = max(0.0, float(spacing))
        except:
            input_spacing = 0.5
    
    # Run enhanced packing algorithm with original output format
    packed_curves, all_transforms, placed_indices, info_text = unified_assembly_pack(
        input_curves, input_width, input_height, input_spacing
    )
    
    debug_msg = "Tight Enhanced Packing - W={}, H={}, Spacing={}".format(input_width, input_height, input_spacing)
    final_info = debug_msg + " | " + info_text
    
    # Grasshopper outputs (matching original format)
    # packed_curves      Packed 2D curves (only successful placements)
    # all_transforms     Transform matrices for ALL input curves (same length as input)
    # placed_indices     Indices of successfully placed curves (for culling lists)
    # final_info         Info text
    
except Exception as e:
    # Set all outputs to empty/error on failure
    packed_curves = []
    all_transforms = []
    placed_indices = []
    final_info = "CRITICAL ERROR: {}\n{}".format(str(e), traceback.format_exc())
# ---------- end python_2 ----------
panel = Panel(python_2.final_info)
item = ListItem(List=python_2.all_transforms, Index=python_2.placed_indices, Wrap=True)
item_2 = ListItem(List=data, Index=python_2.placed_indices, Wrap=True)

# ----
# assembly area
geo_2 = Geometry(rectangle_2.Rectangle)

# ----
# workshop skyline exercise
python_3 = GhPythonScript()  # -> out, a
# ---------- python_3: Python ----------
# =====================================================
# SKYLINE 2D PACKING ALGORITHM
# Step-by-Step Implementation
# =====================================================

"""
This exercise demonstrates the skyline-based 2D bin packing algorithm step by step.
We build the algorithm incrementally, starting with basic concepts
and adding complexity at each step.

Key Concepts:
1. Skyline: Tracks the upper boundary of placed rectangles
2. Greedy Placement: Place largest shapes first in best positions
3. Position Scoring: Prefer bottom-left positions with good support
4. Optimization: Post-process to improve packing density
"""

# =====================================================
# STEP 1: Basic Skyline Class 
# =====================================================

class SimpleSkyline:
    """
    Basic skyline implementation - Workshop Step 1
    
    The skyline is the fundamental data structure for this algorithm.
    It represents the "horizon" or upper boundary of all placed rectangles.

    """
    
    def __init__(self):
        """
        Initialize skyline with single point at origin.
        
        We start with one point (0,0) representing the bottom-left corner
        of our container. As we add rectangles, this list will grow to
        track the changing skyline profile.
        """
        self.points = [(0, 0)]  # Start with single point at origin
        print("Skyline initialized: {0}".format(self.points))
    
    def get_height_at(self, x):
        """
        Get skyline height at position x.
        
        When placing a new rectangle, we need to know
        how high the skyline is at any given X position. The rectangle
        will be placed with its bottom edge touching the skyline.
        
        Args:
            x: X coordinate where we want to know the height
            
        Returns:
            Height of skyline at position x
        """
        # If no points or x is before first point, height is 0 (ground level)
        if not self.points or x <= self.points[0][0]:
            return 0
        
        # Find the segment containing x by checking between consecutive points
        for i in range(len(self.points) - 1):
            x1, y1 = self.points[i]      # Left point of segment
            x2, y2 = self.points[i + 1]  # Right point of segment
            
            # If x falls within this segment
            if x1 <= x <= x2:
                # Return the higher of the two points (worst case for placement)
                return max(y1, y2)
        
        # If x is beyond all points, use the height of the last point
        return self.points[-1][1]
    
    def add_rectangle_simple(self, x, y, width, height):
        """
        Add rectangle - simplified version.
        
        When we place a rectangle, it changes the skyline profile.
        The rectangle creates a "step" in the skyline with two new points:
        - Left edge: goes up to the top of the rectangle
        - Right edge: drops back down to the original height
        
        Args:
            x, y: Bottom-left corner of rectangle
            width, height: Dimensions of rectangle
        """
        print("Adding rectangle at ({0},{1}) size {2}x{3}".format(x, y, width, height))
        
        # Calculate key positions
        left_x = x              # Left edge X coordinate
        right_x = x + width     # Right edge X coordinate  
        top_y = y + height      # Top of rectangle (new skyline height)
        
        # Add the two new skyline points created by this rectangle
        # Left point: skyline goes UP to top of rectangle
        self.points.append((left_x, top_y))
        # Right point: skyline drops back DOWN to original level
        self.points.append((right_x, y))
        
        # Sort points by x coordinate to maintain proper skyline order
        # This is crucial - skyline must be ordered left to right
        self.points.sort()
        print("Skyline updated: {0}".format(self.points))

# WORKSHOP EXERCISE 1: Test Basic Skyline
# This exercise demonstrates the core skyline concept
print("=== EXERCISE 1: Basic Skyline ===")
skyline = SimpleSkyline()

# Place first rectangle at origin
skyline.add_rectangle_simple(0, 0, 3, 2)  # 3 wide, 2 tall rectangle

# Test height queries - this is how we'll find placement positions later
print("Height at x=1: {0}".format(skyline.get_height_at(1)))  # Should be 2 (on top of rectangle)
print("Height at x=4: {0}".format(skyline.get_height_at(4)))  # Should be 0 (past rectangle)
print()

# =====================================================
# STEP 2: Improved Skyline with Simplification
# =====================================================

class ImprovedSkyline:
    """
    Enhanced skyline with point management.
    
    The simple version has a flaw, it accumulates too many points and
    doesn't handle overlapping rectangles properly. This improved version:
    
    1. Removes points that get "covered" by new rectangles
    2. Simplifies redundant points to keep the skyline clean
    3. Handles edge cases better
    
    This is closer to production-quality code.
    """
    
    def __init__(self):
        """Initialize with single origin point."""
        self.points = [(0, 0)]
    
    def add_rectangle(self, x, y, width, height):
        """
        Add rectangle and properly update skyline.
        
        This is more sophisticated than the simple version:
        1. Remove any existing points that fall within the rectangle's X range
        2. Add the new skyline segment created by the rectangle
        3. Clean up redundant points
        
        Args:
            x, y: Bottom-left corner of rectangle
            width, height: Dimensions of rectangle
        """
        new_points = []
        left_x = x              # Left edge of new rectangle
        right_x = x + width     # Right edge of new rectangle
        top_y = y + height      # Top of new rectangle
        
        # STEP 1: Keep only points that are outside the new rectangle's X range
        # Points inside the rectangle's X range get "covered" and should be removed
        for sx, sy in self.points:
            if sx < left_x or sx > right_x:
                new_points.append((sx, sy))
        
        # STEP 2: Add the new skyline segment created by this rectangle
        # The rectangle creates a flat-topped segment between left_x and right_x
        new_points.extend([(left_x, top_y), (right_x, y)])
        
        # STEP 3: Sort points and remove duplicates
        # Convert to set to remove duplicates, then back to sorted list
        self.points = sorted(list(set(new_points)))
        
        # STEP 4: Simplify to remove redundant points
        self._simplify()
    
    def _simplify(self):
        """
        Remove redundant points from skyline.
        
        After adding rectangles, we might have redundant points.
        For example, three consecutive points at the same height
        can be simplified to just the first and last.
        
        This optimization:
        1. Reduces memory usage
        2. Speeds up height queries
        3. Makes skyline easier to debug/visualize
        """
        # Need at least 3 points to have redundancy
        if len(self.points) <= 2:
            return
        
        simplified = [self.points[0]]  # Always keep first point
        
        # Check each middle point to see if it's redundant
        for i in range(1, len(self.points) - 1):
            curr = self.points[i]       # Current point being evaluated
            prev = self.points[i-1]     # Previous point
            next_pt = self.points[i+1]  # Next point
            
            # Keep point if it changes the skyline profile
            # If all three points have same Y, the middle one is redundant
            if not (prev[1] == curr[1] == next_pt[1]):
                simplified.append(curr)
        
        simplified.append(self.points[-1])  # Always keep last point
        self.points = simplified
    
    def get_height_at(self, x):
        """
        Get skyline height at position x.
        Same logic as simple version but more robust.
        """
        if not self.points or x <= self.points[0][0]:
            return 0
        
        # Find segment containing x
        for i in range(len(self.points) - 1):
            if self.points[i][0] <= x <= self.points[i+1][0]:
                return max(self.points[i][1], self.points[i+1][1])
        
        return self.points[-1][1]

# WORKSHOP EXERCISE 2: Test Improved Skyline
# This exercise shows how the improved skyline handles multiple rectangles
print("=== EXERCISE 2: Improved Skyline ===")
skyline2 = ImprovedSkyline()

# Add three rectangles to see how skyline evolves
skyline2.add_rectangle(0, 0, 3, 2)  # Base rectangle
skyline2.add_rectangle(3, 0, 2, 3)  # Taller rectangle to the right
skyline2.add_rectangle(1, 2, 2, 1)  # Small rectangle on top of first one

print("Final skyline: {0}".format(skyline2.points))
print()

# =====================================================
# STEP 3: Shape Class and Basic Placement
# =====================================================

class Shape:
    """
    Represents a rectangular shape to be packed.
    
    This class encapsulates all information about a shape:
    - Dimensions (width, height)
    - Calculated properties (area, aspect ratio)
    - Placement information (x, y, placed status)
    - Identification (index for tracking)
    
    Why use a class instead of just tuples?
    - Cleaner code with named attributes
    - Easy to extend with new properties
    - Better for debugging and logging
    """
    
    def __init__(self, width, height, index=0):
        """
        Initialize shape with dimensions and metadata.
        
        Args:
            width, height: Shape dimensions
            index: Unique identifier for this shape
        """
        # Basic dimensions
        self.width = width
        self.height = height
        
        # Calculated properties used for sorting and optimization
        self.area = width * height                              # Total area
        self.aspect_ratio = max(width, height) / min(width, height)  # How "long" vs "square"
        
        # Identification and status
        self.index = index          # Unique ID for tracking
        self.x = 0                  # Placed X position
        self.y = 0                  # Placed Y position  
        self.placed = False         # Whether successfully placed

class BasicPacker:
    """
    Basic packing algorithm using skyline.
    
    This implements the core packing logic:
    1. Try to find valid positions for each shape
    2. Score positions to prefer bottom-left placement
    3. Update skyline after placing each shape
    
    This is a heuristic algorithm, it makes the locally best choice
    at each step without looking ahead. While not optimal, it's fast
    and produces good results for most cases.
    """
    
    def __init__(self, container_width, container_height, spacing=0.5):
        """
        Initialize packer with container dimensions.
        
        Args:
            container_width, container_height: Size of packing area
            spacing: Minimum gap between shapes (prevents tight contact)
        """
        self.container_width = container_width
        self.container_height = container_height
        self.spacing = spacing
        
        # Create fresh skyline and shape list for this packing session
        self.skyline = ImprovedSkyline()
        self.placed_shapes = []
    
    def can_place_at(self, shape, x, y):
        """
        Check if shape can be placed at position (x,y).
        
        This validates two things:
        1. Boundary check: Shape fits within container
        2. Collision check: Shape doesn't overlap existing shapes (with spacing)
        
        Args:
            shape: Shape object to place
            x, y: Proposed bottom-left position
            
        Returns:
            True if position is valid, False otherwise
        """
        # BOUNDARY CHECK: Shape must fit entirely within container
        if (x < 0 or y < 0 or 
            x + shape.width > self.container_width or 
            y + shape.height > self.container_height):
            return False
        
        # COLLISION CHECK: Shape must not overlap any existing shape
        # We check if rectangles are separated by at least 'spacing' distance
        for placed in self.placed_shapes:
            # Two rectangles don't overlap if one is completely to the side of the other
            # We need spacing gap, so use (width + spacing) for separation check
            horizontal_clear = (x + shape.width + self.spacing <= placed.x or
                              placed.x + placed.width + self.spacing <= x)
            vertical_clear = (y + shape.height + self.spacing <= placed.y or
                            placed.y + placed.height + self.spacing <= y)
            
            # If not clear in both directions, we have a collision
            if not (horizontal_clear or vertical_clear):
                return False
        
        return True  # All checks passed
    
    def find_position(self, shape):
        """
        Find best position for shape using skyline.
        
        Strategy: Try positions along the skyline at regular intervals.
        Score each valid position and return the best one.
        
        Scoring: Prefer positions that are:
        - Lower (smaller Y coordinate) 
        - More to the left (smaller X coordinate)
        
        Args:
            shape: Shape to find position for
            
        Returns:
            (x, y) tuple of best position, or None if no valid position
        """
        best_position = None
        best_score = float('inf')  # Start with worst possible score
        
        # Try positions along the skyline at regular intervals
        step_size = 0.5  # How finely to sample positions (smaller = more thorough)
        x = 0
        
        while x <= self.container_width - shape.width:
            # Get skyline height at this X position
            y = self.skyline.get_height_at(x)
            
            # Check if we can place the shape here
            if self.can_place_at(shape, x, y):
                # Score this position: prefer bottom-left
                # Multiply Y by large number to prioritize lower positions over left positions
                score = y * 1000 + x
                
                if score < best_score:
                    best_score = score
                    best_position = (x, y)
            
            x += step_size
        
        return best_position
    
    def place_shape(self, shape):
        """
        Place a shape in the container.
        
        This is the main packing operation:
        1. Find the best position for the shape
        2. If found, update shape coordinates and add to placed list
        3. Update skyline to reflect the new shape
        
        Args:
            shape: Shape to place
            
        Returns:
            True if shape was successfully placed, False otherwise
        """
        position = self.find_position(shape)
        
        if position:
            # Update shape with placement information
            shape.x, shape.y = position
            shape.placed = True
            
            # Add to our list of placed shapes
            self.placed_shapes.append(shape)
            
            # Update skyline to reflect this new shape
            self.skyline.add_rectangle(shape.x, shape.y, shape.width, shape.height)
            
            return True
        
        return False  # Could not find valid position

# WORKSHOP EXERCISE 3: Test Basic Packer
# This exercise demonstrates the complete basic packing process
print("=== EXERCISE 3: Basic Packing ===")

# Create a packer with 10x10 container
packer = BasicPacker(10, 10)

# Create some shapes to pack
shapes = [
    Shape(3, 2, 0),  # Medium rectangle
    Shape(2, 3, 1),  # Tall rectangle  
    Shape(4, 1, 2),  # Wide rectangle
    Shape(1, 4, 3)   # Very tall rectangle
]

# Try to place each shape
for shape in shapes:
    success = packer.place_shape(shape)
    if success:
        print("Shape {0} placed at ({1}, {2})".format(shape.index, shape.x, shape.y))
    else:
        print("Shape {0} could not be placed".format(shape.index))

print("Final skyline: {0}".format(packer.skyline.points))
print()

# =====================================================
# STEP 4: Advanced Position Finding
# =====================================================

class AdvancedPacker(BasicPacker):
    """
    Advanced packer with better position finding.
    
    The basic packer only tries positions along the skyline at regular intervals.
    This advanced version is smarter about finding candidate positions:
    
    1. Uses finer step size for more precision
    2. Tries positions adjacent to existing shapes  
    3. Considers "corner" positions where shapes can nestle together
    4. Uses sophisticated scoring that considers support from below
    
    This typically achieves much better packing density.
    """
    
    def find_all_candidates(self, shape):
        """
        Find all candidate positions for a shape.
        
        Instead of just trying regular intervals, this method finds
        "interesting" positions where the shape might fit well:
        
        1. Bottom-left corner (always good)
        2. Positions along skyline (fine-grained sampling)
        3. Adjacent to existing shapes (left/right edges)
        4. On top of existing shapes
        5. Corner positions (nestling between shapes)
        
        Args:
            shape: Shape to find candidates for
            
        Returns:
            List of (x, y) candidate positions
        """
        candidates = []
        
        # CANDIDATE TYPE 1: Bottom-left corner
        # This is always a good position if it fits
        candidates.append((0, 0))
        
        # CANDIDATE TYPE 2: Skyline positions
        # Sample along skyline with fine resolution for precision
        step_size = 0.1  # Much finer than basic packer
        x = 0
        while x <= self.container_width - shape.width:
            y = self.skyline.get_height_at(x)
            candidates.append((x, y))
            x += step_size
        
        # CANDIDATE TYPE 3 & 4: Adjacent to existing shapes
        for placed in self.placed_shapes:
            # Right edge positions - place shape to the right of existing shape
            candidates.append((placed.x + placed.width + self.spacing, placed.y))
            candidates.append((placed.x + placed.width + self.spacing, 0))  # Also try at ground level
            
            # Top edge positions - place shape on top of existing shape
            candidates.append((placed.x, placed.y + placed.height + self.spacing))
            
            # CANDIDATE TYPE 5: Corner positions - nestling between shapes
            candidates.append((placed.x + placed.width + self.spacing, 
                             placed.y + placed.height + self.spacing))
            
            # Left-aligned on top - align left edges
            candidates.append((placed.x, placed.y + placed.height + self.spacing))
            
            # Right-aligned on top - align right edges
            right_align_x = placed.x + placed.width - shape.width
            if right_align_x >= 0:  # Only if shape fits
                candidates.append((right_align_x, placed.y + placed.height + self.spacing))
        
        return candidates
    
    def calculate_score(self, x, y, shape):
        """
        Calculate score for a position.
        
        Advanced scoring considers multiple factors:
        1. Height penalty: prefer lower positions (most important)
        2. Left preference: prefer leftward positions (secondary)
        3. Support bonus: reward positions with good support from below
        
        Lower scores are better.
        
        Args:
            x, y: Position to score
            shape: Shape being placed
            
        Returns:
            Numerical score (lower is better)
        """
        # Base score: heavily prefer bottom-left positions
        # Y is weighted much more heavily than X (height is more important than left/right)
        score = y * 10000 + x * 100
        
        # SUPPORT BONUS: Shapes with good bottom support get big score reduction
        support = self.calculate_bottom_support(x, y, shape)
        score -= support * 5000  # Large bonus for well-supported placements
        
        return score
    
    def calculate_bottom_support(self, x, y, shape):
        """
        Calculate how much support shape has from below.
        
        Shapes that rest solidly on other shapes or the ground pack better
        than shapes that are "floating" with minimal support.
        
        Support ranges from 0.0 (no support) to 1.0 (full support).
        
        Args:
            x, y: Position of shape
            shape: Shape being evaluated
            
        Returns:
            Support ratio (0.0 to 1.0)
        """
        # Ground contact = perfect support
        if y <= 0.1:  # Small tolerance for floating point precision
            return 1.0
        
        total_support = 0
        
        # Check each existing shape to see if it provides bottom support
        for placed in self.placed_shapes:
            # Does this placed shape provide support?
            # It provides support if:
            # 1. Its top edge + spacing equals our bottom edge (vertically adjacent)
            # 2. There's horizontal overlap between the shapes
            
            support_height = placed.y + placed.height + self.spacing
            if abs(support_height - y) <= 0.1:  # Vertically adjacent (with tolerance)
                # Calculate horizontal overlap
                overlap_start = max(x, placed.x)
                overlap_end = min(x + shape.width, placed.x + placed.width)
                overlap = max(0, overlap_end - overlap_start)
                
                # Add this shape's contribution to total support
                # (overlap width / shape width) gives fraction of shape that's supported
                total_support += overlap / shape.width
        
        # Cap at 1.0 (can't have more than 100% support)
        return min(1.0, total_support)
    
    def find_position(self, shape):
        """
        Find best position using advanced scoring.
        
        This overrides the basic version to use the advanced candidate
        generation and scoring system.
        """
        candidates = self.find_all_candidates(shape)
        
        best_position = None
        best_score = float('inf')
        
        # Evaluate each candidate position
        for x, y in candidates:
            if self.can_place_at(shape, x, y):
                score = self.calculate_score(x, y, shape)
                if score < best_score:
                    best_score = score
                    best_position = (x, y)
        
        return best_position

# WORKSHOP EXERCISE 4: Test Advanced Packer
# This demonstrates the improvement from advanced position finding
print("=== EXERCISE 4: Advanced Packing ===")

# Create larger container to see the difference
advanced_packer = AdvancedPacker(12, 8)

# Create mix of different sized shapes
shapes = [
    Shape(4, 3, 0),  # Large rectangle
    Shape(3, 2, 1),  # Medium rectangle
    Shape(2, 4, 2),  # Tall rectangle
    Shape(3, 1, 3),  # Wide, short rectangle
    Shape(1, 3, 4)   # Narrow, tall rectangle
]

# IMPORTANT: Sort by area (largest first)
# This is a key heuristic - placing large shapes first usually gives better results
shapes.sort(key=lambda s: -s.area)

for shape in shapes:
    success = advanced_packer.place_shape(shape)
    if success:
        print("Shape {0} ({1}x{2}) placed at ({3}, {4})".format(
            shape.index, shape.width, shape.height, shape.x, shape.y))
    else:
        print("Shape {0} could not be placed".format(shape.index))

print("Placed {0} out of {1} shapes".format(
    len(advanced_packer.placed_shapes), len(shapes)))
print()

# =====================================================
# STEP 5: Complete Algorithm with Optimization
# =====================================================

class OptimizedPacker(AdvancedPacker):
    """
    Complete packer with post-processing optimization.
    
    Even the advanced packer can be improved. This final version adds:
    
    1. Smart shape sorting (by area AND aspect ratio)
    2. Post-processing optimization passes
    3. Local improvement (trying to move shapes to better positions)
    
    The optimization works by temporarily removing shapes and trying
    to place them in better positions. This can significantly improve
    the final packing density.
    """
    
    def pack_shapes(self, shapes):
        """
        Pack all shapes with optimization.
        
        This is the main entry point for the complete algorithm:
        1. Sort shapes intelligently
        2. Place shapes greedily  
        3. Run optimization passes
        4. Return final result
        
        Args:
            shapes: List of Shape objects to pack
            
        Returns:
            List of successfully placed shapes
        """
        # STEP 1: Smart sorting
        # Primary: largest area first (big shapes are harder to place)
        # Secondary: higher aspect ratio first (long shapes are harder to place)
        sorted_shapes = sorted(shapes, key=lambda s: (-s.area, -s.aspect_ratio))
        
        # STEP 2: Initial greedy placement
        for shape in sorted_shapes:
            self.place_shape(shape)
        
        # STEP 3: Post-processing optimization
        self.optimize_placement()
        
        return self.placed_shapes
    
    def optimize_placement(self):
        """
        Post-processing optimization.
        
        After initial placement, try to improve the packing by:
        1. Removing shapes one at a time
        2. Rebuilding skyline without that shape
        3. Trying to place the shape in a better position
        4. Repeating until no improvements are found
        
        This is expensive but can significantly improve results.
        """
        max_iterations = 3  # Limit iterations to prevent infinite loops
        
        for iteration in range(max_iterations):
            improved = False
            
            # Sort shapes by Y position (optimize from bottom up)
            # This order tends to give better optimization results
            self.placed_shapes.sort(key=lambda s: (s.y, s.x))
            
            # Try to improve each shape's position
            for shape in self.placed_shapes[:]:  # Copy list since we'll modify it
                # Remove shape temporarily
                self.placed_shapes.remove(shape)
                
                # Rebuild skyline without this shape
                self.rebuild_skyline()
                
                # Try to find a better position
                new_position = self.find_position(shape)
                
                if new_position and (new_position[1] < shape.y or 
                                   (new_position[1] == shape.y and new_position[0] < shape.x)):
                    # Found better position (lower or more left at same height)
                    shape.x, shape.y = new_position
                    improved = True
                
                # Add shape back (either at old or new position)
                self.placed_shapes.append(shape)
                self.skyline.add_rectangle(shape.x, shape.y, shape.width, shape.height)
            
            # If no improvements found, we're done optimizing
            if not improved:
                break
    
    def rebuild_skyline(self):
        """
        Rebuild skyline from current placed shapes.
        
        When we remove a shape during optimization, we need to rebuild
        the skyline to reflect the new state. This involves:
        1. Creating fresh skyline
        2. Adding all remaining shapes back to it
        """
        self.skyline = ImprovedSkyline()
        for shape in self.placed_shapes:
            self.skyline.add_rectangle(shape.x, shape.y, shape.width, shape.height)

# WORKSHOP EXERCISE 5: Test Complete Algorithm
# This demonstrates the full algorithm with optimization
print("=== EXERCISE 5: Complete Optimized Packing ===")

# Create even larger test case
optimized_packer = OptimizedPacker(15, 10)
shapes = [
    Shape(3, 4, 0), Shape(5, 2, 1), Shape(2, 3, 2), Shape(4, 3, 3),
    Shape(2, 2, 4), Shape(3, 1, 5), Shape(1, 4, 6), Shape(4, 1, 7)
]

# Use the complete packing method
packed_shapes = optimized_packer.pack_shapes(shapes)

print("Successfully packed {0} shapes:".format(len(packed_shapes)))
for shape in packed_shapes:
    print("  Shape {0}: {1}x{2} at ({3}, {4})".format(
        shape.index, shape.width, shape.height, shape.x, shape.y))

# Calculate and display packing efficiency
total_area = sum(s.area for s in packed_shapes)
if packed_shapes:
    used_width = max(s.x + s.width for s in packed_shapes)
    used_height = max(s.y + s.height for s in packed_shapes)
    container_area = used_width * used_height
    efficiency = (total_area / container_area) * 100
    print("Packing efficiency: {0:.1f}%".format(efficiency))
    print("Container usage: {0} x {1}".format(used_width, used_height))

print("\n=== WORKSHOP COMPLETE ===")
print("You now understand the complete 2D packing algorithm!")
print("Key concepts learned:")
print("1. Skyline data structure for tracking shape boundaries")
print("2. Heuristic placement with intelligent position scoring")
print("3. Advanced candidate generation for better results")
print("4. Post-processing optimization for maximum efficiency")
print("5. Shape sorting strategies for improved outcomes")
print("\nNext steps: Integrate with Grasshopper curve inputs")
# ---------- end python_3 ----------
panel_2 = Panel(python_3.out)

# ----
# packed curves
geo_3 = Geometry(python_2.packed_curves)

# ----
# align convex hull geometries with mapped contours
data_3 = Data([{TransformCount=1, Name="Generic", m00=0.001694327427, m01=4.67e-17, m02=-0.9999985646, m03=19.89122977, m10=-0.9999985646, m11=-2.33e-16, m12=-0.001694327427, m13=-2.13728361, m20=-2.33e-16, m21=1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}, {TransformCount=1, Name="Generic", m00=0.0910886314, m01=5.7e-17, m02=-0.9958427894, m03=41.51931087, m10=-0.9958427894, m11=-1.36e-16, m12=-0.0910886314, m13=-3.319018909, m20=-1.4e-16, m21=1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}, {TransformCount=1, Name="Generic", m00=-0.003632664921, m01=0.9999934019, m02=0, m03=50.29489105, m10=-0.9999934019, m11=-0.003632664921, m12=0, m13=-3.071928217, m20=0, m21=0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}, {TransformCount=1, Name="Generic", m00=4.98e-17, m01=0.0380251373, m02=0.9992767829, m03=61.56591605, m10=-1.53e-17, m11=-0.9992767829, m12=0.0380251373, m13=-2.494893222, m20=1, m21=-1.72e-17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}, {TransformCount=1, Name="Generic", m00=0.9982171342, m01=-0.05968712638, m02=0, m03=84.74139573, m10=-0.05968712638, m11=-0.9982171342, m12=0, m13=-2.200794376, m20=0, m21=0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}, {TransformCount=1, Name="Generic", m00=0.03238840154, m01=0.9994753581, m02=0, m03=100.6047011, m10=-0.9994753581, m11=0.03238840154, m12=0, m13=-6.461048931, m20=0, m21=0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}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])

transform = Transform(Geometry=data_2, Transform=data_3)
item_3 = ListItem(List=transform, Index=python_2.placed_indices, Wrap=True)
X = UnitX(Factor=1)
transform_2 = Transform(Geometry=item_3, Transform=item)
rot3d = Rotate3D(Geometry=transform_2, Angle=1.570796327, Center=Point(0, 0, 0), Axis=X)  # -> Geometry, Transform

# ----
# map wall segment to target geometry
number_slider_8 = Slider(90, range=0..100)
neg = Negative(Value=number_slider_8)
unroll = Unroll(MeshOrBrep=extr)  # -> Brep, Curves, Points, TextDotsLocation, TextDots
rad = Radians(Degrees=neg)
rotate = Rotate(Geometry=unroll.Brep, Angle=rad, Plane=PlaneXY(0, 0, 0))  # -> Geometry, Transform
X_2 = UnitX(Factor=1)
rad_2 = Radians(Degrees="270")
rot3d_2 = Rotate3D(Geometry=rotate.Geometry, Angle=rad_2, Center=Point(0, 0, 0), Axis=X_2)  # -> Geometry, Transform
addition = Addition(A=Slider(1, range=0..1), B=number_slider_3)
subtraction = Subtraction(A=number_slider, B=addition)
map_srf = MapToSurface(Curve=rectangle.Rectangle, Source=rot3d_2.Geometry, Target=extr)
dom = ConstructDomain(DomainStart=Slider(0, range=0..1), DomainEnd=subtraction)
md_slider = MDSlider(SliderMode=0, slider_value=Point(0.5, 0.5, 0.5), x_domain=Domain(0, 1), y_domain=Domain(0, 1), z_domain=Domain(0, 1))
remap = RemapNumbers(Value=Slider(0, range=0..3, expression="x*0.25"), Source=Domain(0, 1), Target=dom)  # -> Mapped, Clipped
boundary = BoundarySurfaces(Edges=map_srf)
X_3 = UnitX(Factor=remap.Mapped)
evalsrf = EvaluateSurface(Surface=boundary, Point=md_slider)  # -> Point, Normal, UDirection, VDirection, Frame
project = Project(Curve=map_srf, Brep=extr, Direction=evalsrf.Normal)
move = Move(Geometry=project, Motion=X_3)  # -> Geometry, Transform
srfsplit = SurfaceSplit(Surface=extr, Curves=move.Geometry)
item_4 = ListItem(List=srfsplit, Index=0, Wrap=True)  # -> Item, Item1
area = Area(Geometry=item_4.Item)  # -> Area, Centroid
area_2 = Area(Geometry=item_4.Item1)  # -> Area, Centroid

larger = LargerThan(FirstNumber=area.Area, SecondNumber=area_2.Area)  # -> LargerThan, OrEqualTo

filter = StreamFilter(Gate=larger.LargerThan, Stream0=item_4.Item, Stream1=item_4.Item1)
brep = Brep(filter)

# ----
# unroll wall segment for 2d packing
debrep = DeconstructBrep(Brep=brep)  # -> Faces, Edges, Vertices
crv = Curve(debrep.Edges)
unroll_2 = Unroll(MeshOrBrep=brep, Curves=crv, Points=debrep.Vertices)  # -> Brep, Curves, Points, TextDotsLocation, TextDots

# ----
# set bounding frames for assembly
md_slider_2 = MDSlider(SliderMode=0, slider_value=Point(0.5, 0.5, 0.5), x_domain=Domain(0, 1), y_domain=Domain(0, 1), z_domain=Domain(0, 1))
smesh = SimpleMesh(Brep=brep)
facen = FaceNormals(Mesh=smesh)  # -> Centers, Normals
panel_3 = Panel("""-7.5
7.5""")
item_5 = ListItem(List=debrep.Edges, Index=0, Wrap=True)  # -> Item, Item1, Item2, Item3
eval = EvaluateCurve(Curve=reparameterize(item_5.Item), Parameter=md_slider_2)  # -> Point, Tangent, Angle
multiplication_2 = Multiplication(A=facen.Normals, B=panel_3)
xprod = CrossProduct(VectorA=facen.Normals, VectorB=eval.Tangent, Unitize=False)  # -> expr("x*-1", Vector), Length
extr_2 = Extrude(Base=item_5.Item, Direction=multiplication_2)
extr_3 = Extrude(Base=item_5.Item2, Direction=multiplication_2)
extr_4 = Extrude(Base=extr_3, Direction=expr("x*-1", xprod.Vector))
extr_5 = Extrude(Base=extr_2, Direction=xprod.Vector)
join = BrepJoin(Breps=extr_5)  # -> Breps, Closed
join_2 = BrepJoin(Breps=extr_4)  # -> Breps, Closed

# ----
# adjust wall segment surface orientation
number_slider_9 = Slider(90, range=0..100)
neg_2 = Negative(Value=number_slider_9)
rad_3 = Radians(Degrees=neg_2)
rotate_2 = Rotate(Geometry=unroll_2.Brep, Angle=rad_3, Plane=PlaneXY(0, 0, 0))  # -> Geometry, Transform
X_4 = UnitX(Factor=1)
rad_4 = Radians(Degrees="270")
rot3d_3 = Rotate3D(Geometry=rotate_2.Geometry, Angle=rad_4, Center=Point(0, 0, 0), Axis=X_4)  # -> Geometry, Transform
rad_5 = Radians(Degrees="90")
X_5 = UnitX(Factor=1)
neg_3 = Negative(Value=Slider(270, range=0..1000))
rad_6 = Radians(Degrees=neg_3)
rot3d_4 = Rotate3D(Geometry=rot3d_3.Geometry, Angle=rad_5, Center=Point(0, 0, 0), Axis=X_5)  # -> Geometry, Transform
rotate_3 = Rotate(Geometry=rot3d_4.Geometry, Angle=rad_6, Plane=PlaneXY(0, 0, 0))  # -> Geometry, Transform

# ----
# bounding support
brep_2 = Brep([join_2.Breps, join.Breps])

# ----
# visualization
lng = ListLength(List=flatten(rot3d.Geometry))
random = Random(Range=Domain(0, 1), Number=lng, Seed=2)
gradient = Gradient(
    LowerLimit=0,
    UpperLimit=1,
    Parameter=random,
    stops=[0: RGB(243, 57, 0), 0.1: RGB(236, 27, 60), 0.3: RGB(103, 0, 120), 0.4: RGB(39, 72, 161), 0.6: RGB(18, 178, 90), 0.7: RGB(79, 186, 8), 0.8: RGB(220, 237, 32), 0.9: RGB(247, 159, 20), 1: RGB(1, 192, 229), 1: RGB(243, 57, 0)])
preview = CustomPreview(Geometry=flatten(brep_2), Material=ColourSwatch(SwatchColor=RGB(255, 254, 254)))

# ----
# bounding support
brep_3 = Brep([join_2.Breps, join.Breps])

# ----
# packed meshes
preview_2 = CustomPreview(Geometry=flatten(rot3d.Geometry), Material=gradient)

# ----
# export objs for assembly
button = Button()
python_4 = GhPythonScript(save=button, meshes=flatten(rot3d.Geometry), file_names=item_2)  # -> out; inputs save: Boolean, meshes: list of Mesh, file_names: list
# ---------- python_4: Python ----------
import Rhino
import os
import System
import compas
from compas.datastructures import Mesh

def save_mesh_as_obj(mesh, filename):
    # Get the path of the current Grasshopper document
    gh_file_path = ghenv.Component.OnPingDocument().FilePath
    current_folder = os.path.dirname(gh_file_path)
    
    # Define the path to OBJ_Files one level above the current folder
    obj_folder = os.path.join(os.path.dirname(current_folder), "OBJ_Files")
    
    # Build the full file path in the OBJ_Files folder
    full_path = os.path.join(obj_folder, filename + ".obj")
    
    # Get the vertices from the mesh
    vertices = [(vertex.X, vertex.Y, vertex.Z) for vertex in mesh.Vertices]

    # Get the faces from the mesh
    faces = []
    for face in mesh.Faces:
        if face.IsQuad:
            faces.append([face.A, face.B, face.C, face.D])  # Quad face
        else:
            faces.append([face.A, face.B, face.C])  # Triangle face
        
    mesh = Mesh.from_vertices_and_faces(vertices, faces)
    mesh.to_obj(full_path)
    print("Mesh successfully saved to:", full_path)

# Ensure that `file_names` list length matches `meshes` list length
if len(meshes) == len(file_names):
    for mesh, filename in zip(meshes, file_names):
        save_mesh_as_obj(mesh, filename)
else:
    print("Error: The number of file names does not match the number of meshes.")
# ---------- end python_4 ----------
python_5 = GhPythonScript(save=button, meshes=flatten(brep_2))  # -> out; inputs save: Boolean, meshes: list of Mesh; disabled
# ---------- python_5: Python ----------
import Rhino
import os
import System
import compas
from compas.datastructures import Mesh

import Rhino
import os
import System
import compas
from compas.datastructures import Mesh

def save_mesh_as_obj(mesh, filename):
    # Get the path of the current Grasshopper document
    gh_file_path = ghenv.Component.OnPingDocument().FilePath
    current_folder = os.path.dirname(gh_file_path)
    
    # Define the path to OBJ_Files one level above the current folder
    obj_folder = os.path.join(os.path.dirname(current_folder), "OBJ_Files")
    
    # Build the full file path in the OBJ_Files folder
    full_path = os.path.join(obj_folder, filename + ".obj")
    
    # Get the vertices from the mesh
    vertices = [(vertex.X, vertex.Y, vertex.Z) for vertex in mesh.Vertices]

    # Get the faces from the mesh
    faces = []
    for face in mesh.Faces:
        if face.IsQuad:
            faces.append([face.A, face.B, face.C, face.D])  # Quad face
        else:
            faces.append([face.A, face.B, face.C])  # Triangle face
        
    mesh = Mesh.from_vertices_and_faces(vertices, faces)
    mesh.to_obj(full_path)
    print("Mesh successfully saved to:", full_path)

# Save each mesh with a custom filename in the OBJ_Files directory
for i, mesh in enumerate(meshes):
    filename = "wall_support_" + str(i)
    save_mesh_as_obj(mesh, filename)
# ---------- end python_5 ----------

# ---- group: This projects polygons to plane
crv_2 = Curve(python.a)

# ----
# pack and map convex hull contours using Opennest
join_3 = JoinCurves(Curves=python.a, Preserve=False)
geo_4 = Geometry(brep)

# ---- group: This projects polygons to plane (continued)
pack = PackObjects(Geo=crv_2, Plane=join_3, X=1, Y=1, Tolerabce=3.14)  # -> Geo, Transformation

# ----
opennest = OpenNest(
    Sheets=rotate_3.Geometry,
    Geo=pack.Geo,
    Spacing=Slider(0, range=0..100),
    Placement=1,
    Tolerance=Slider(0.1, range=0..0.1),
    Rotations=Slider(1, range=0..10),
    Iterations=1,
    Seed=Slider(4, range=0..10),
    Reset=True,
    Run=Toggle(True))  # -> Sheets, Geo, ID, Transform, IDS
boundary_2 = BoundarySurfaces(Edges=opennest.Sheets)
cull = CullPattern(List=opennest.Geo, CullPattern=invert(opennest.IDS))
transform_3 = Transform(Geometry=data_2, Transform=pack.Transformation)
dim = Dimensions(Surface=boundary_2)  # -> UDimension, VDimension
transform_4 = Transform(Geometry=transform_3, Transform=opennest.Transform)
cull_2 = CullPattern(List=transform_4, CullPattern=invert(opennest.IDS))
rebsrf = RebuildSurface(Surface=geo_4, DomainU=dim.UDimension, DomainV=dim.VDimension)
map_srf_2 = MapToSurface(Curve=cull, Source=rotate_3.Geometry, Target=rebsrf)

# ----
# align convex hull geometries with mapped contours
target_curve = Curve(map_srf_2)
geo_5 = Geometry(cull_2)
crv_3 = Curve(cull)

# ---- group: Plane 1
crv_4 = Curve(reparameterize(target_curve))
eval_2 = EvaluateCurve(Curve=crv_4, Parameter=Slider(0, range=0..1))  # -> Point, Tangent, Angle
eval_3 = EvaluateCurve(Curve=crv_4, Parameter=Slider(0.26, range=0..1))  # -> Point, Tangent, Angle
xprod_2 = CrossProduct(VectorA=eval_2.Tangent, VectorB=eval_3.Tangent, Unitize=False)  # -> Vector, Length
xprod_3 = CrossProduct(VectorA=eval_2.Point, VectorB=xprod_2.Vector, Unitize=False)  # -> Vector, Length
divide_2 = DivideCurve(Curve=crv_4, Count=Slider(125, range=0..1000), Kinks=False)  # -> Points, Tangents, Parameters
avr = Average(Input=divide_2.Points)
pl = ConstructPlane(Origin=simplify(flatten(avr)), XAxis=eval_2.Tangent, YAxis=xprod_3.Vector)

crv_5 = Curve(reparameterize(crv_3))
eval_4 = EvaluateCurve(Curve=crv_5, Parameter=Slider(0, range=0..1))  # -> Point, Tangent, Angle
eval_5 = EvaluateCurve(Curve=crv_5, Parameter=Slider(0.26, range=0..1))  # -> Point, Tangent, Angle
xprod_4 = CrossProduct(VectorA=eval_4.Tangent, VectorB=eval_5.Tangent, Unitize=False)  # -> Vector, Length
xprod_5 = CrossProduct(VectorA=eval_4.Point, VectorB=xprod_4.Vector, Unitize=False)  # -> Vector, Length

# ----
area_3 = Area(Geometry=crv_5)  # -> Area, Centroid

# ---- group: Plane 1 (continued)
pl_2 = ConstructPlane(Origin=area_3.Centroid, XAxis=eval_4.Tangent, YAxis=xprod_5.Vector)

# ----
orient = Orient(Geometry=simplify(graft(geo_5)), Source=simplify(graft(pl_2)), Target=simplify(graft(pl)))  # -> Geometry, Transform

lng_2 = ListLength(List=flatten(orient.Geometry))
random_2 = Random(Range=Domain(0, 1), Number=lng_2, Seed=2)
gradient_2 = Gradient(
    LowerLimit=0,
    UpperLimit=1,
    Parameter=random_2,
    stops=[0: RGB(243, 57, 0), 0.1: RGB(236, 27, 60), 0.3: RGB(103, 0, 120), 0.4: RGB(39, 72, 161), 0.6: RGB(18, 178, 90), 0.7: RGB(79, 186, 8), 0.8: RGB(220, 237, 32), 0.9: RGB(247, 159, 20), 1: RGB(1, 192, 229), 1: RGB(243, 57, 0)])
preview_3 = CustomPreview(Geometry=flatten(brep_3), Material=ColourSwatch(SwatchColor=RGB(255, 254, 254)))

# ----
# packed meshes
preview_4 = CustomPreview(Geometry=flatten(orient.Geometry), Material=gradient_2)

# ----
# export objs for assembly
button_2 = Button()
python_6 = GhPythonScript(save=button_2, meshes=flatten(orient.Geometry), file_names=data)  # -> out; inputs save: Boolean, meshes: list of Mesh, file_names: list; disabled; same code as python_4
python_7 = GhPythonScript(save=button_2, meshes=flatten(brep_3))  # -> out; inputs save: Boolean, meshes: list of Mesh; disabled; same code as python_5
